# Grasshopper definition curvature_lines.gh (Grasshopper 0.9.14)
# plug-ins: Decodes Python Interpreter

md_slider = MDSlider(
    slider_value=Point(0.6654635174, 0.6868484776, 0.5),
    x_domain=Domain(0, 1),
    y_domain=Domain(0, 1),
    z_domain=Domain(0, 1),
    SliderMode=0)
_0_75_0_5 = Point(Point(0.5, 0.75, 0))
_0_5_0_5 = Point(Point(0.5, 0.5, 0))
decodes = DecodesPythonScript(uv=md_slider)  # -> console, a, b, c, d
# ---------- decodes: Python ----------
u,v = uv.x,uv.y
step = 0.1

def func(u,v):
    return Point(u,v,(u**3-3*u*v**2))
    
ival = Interval(-1,1)
surf = Surface(func,ival,ival)
crv = surf.eval_curv(u,v,True)
crv_cs = crv[0]
a.put(surf.surrogate)
b.put(crv_cs)

pt, u_vec, v_vec = surf._nudged(ival.eval(u),ival.eval(v),False)
u_vec = u_vec.normalized() #TODO: these should be normalized to proportion of domain rect
v_vec = v_vec.normalized()
n_vec = u_vec.cross(v_vec)
crv_vec = crv_cs.x_axis.normalized()
#crv_vec = crv.x_axis.inverted().normalized() # to switch direction of curv lines
#crv_vec = crv.y_axis.inverted().normalized()

xsec = Intersector()
pln = Plane(pt+crv_vec,v_vec.cross(n_vec))
if xsec.of(pln,u_vec.to_line(pt)):
    d.put(xsec[0])
    du = xsec[0].distance(pt)
else: print "no intersection", xsec.log
pln = Plane(pt+crv_vec,u_vec.cross(n_vec))
if xsec.of(pln,v_vec.to_line(pt)):
    dv = xsec[0].distance(pt)
    d.put(xsec[0])
else: print "no intersection", xsec.log


d_vec = Vec(du,dv).normalized(step)
print du,dv,d_vec
uv = uv+d_vec
u,v = uv.x,uv.y
c.put(surf.eval(u,v))

b.put([pt,u_vec.to_ray(pt),v_vec.to_ray(pt),crv_vec.to_ray(pt)])
#pln = surf.deval_pln(u,v)
# ---------- end decodes ----------
panel = Panel(decodes.console)
data = Data(decodes.b)
