# Grasshopper definition gh out test.gh (Grasshopper 0.9.14)
# plug-ins: Python Interpreter

slider = Slider(5, range=0..10)
python = PythonScript(x=slider)  # -> out, a, b, c
# ---------- python: Python ----------
## BEGIN HEAD ##
import decodes.core as dc
from decodes.core import *
a = dc.makeOut(outies.Grasshopper)
b = dc.makeOut(outies.Grasshopper)
c = dc.makeOut(outies.Grasshopper)

## END HEAD ##



pt = Point(1,1,x)
vec = Vec(0,10,x)
seg = Line(Point(1,1,x),Vec(0,0,-2))
cs = CS(Point(-2,-x), Vec(0,2,x))

verts = [
  Point(0.0       , 0.0	      , 0.0),
  Point(0.9510565 , 0.0	      , 0.0),
  Point(0.6881910 , 1.3763819 , 0.0),
  Point(0.5257311 , 0.6881910	, x/2)
]
faces = [[0,1,2],[0,2,3],[2,3,0],[3,0,1]]
mesh = dc.Mesh(verts,faces)

a.put(mesh)
a.put([[pt,pt,pt],[pt,pt,pt]])
a.put(vec)
#a.put(10)

b.put(10)
b.put(20)

c.put("sdf")
c.put('d')


## BEGIN FOOT ##
if isinstance(a, dc.outies.GrasshopperOut) : a = a.extract_tree()
if isinstance(b, dc.outies.GrasshopperOut) : b = b.extract_tree()
if isinstance(c, dc.outies.GrasshopperOut) : c = c.extract_tree()

## END FOOT ##
# ---------- end python ----------
python_2 = PythonScript(x=slider)  # -> out, a
# ---------- python_2: Python ----------
## BEGIN HEAD ##
import decodes.core as dc
from decodes.core import *
a = dc.makeOut(outies.Grasshopper)

## END HEAD ##
import decodes.extensions.danzerTile as dt

maxRecursion = 3
def recurse(tiles,rlvl=0):
  if rlvl < maxRecursion : return [recurse(tile.inflate(),rlvl+1) for tile in tiles]
  else : return [tile.draw() for tile in tiles]

a.put( recurse([dt.DzTileK()]) ) 

## BEGIN FOOT ##
if isinstance(a, dc.outies.GrasshopperOut) : a = a.extract_tree()

## END FOOT ##
# ---------- end python_2 ----------
panel = Panel(python.a)
panel_2 = Panel(python_2.out)
panel_3 = Panel(python.out)
panel_4 = Panel(python.b)
panel_5 = Panel(python.c)
