# Grasshopper definition vec field test.gh (Grasshopper 0.9.14)
# plug-ins: Decodes Python Interpreter

md_slider = MDSlider(
    slider_value=Point(0.3896697908, 0.3293986524, 0.5),
    x_domain=Domain(-2, 10),
    y_domain=Domain(-2, 10),
    z_domain=Domain(0, 1),
    SliderMode=0)
pt = Point(md_slider)
decodes = DecodesPythonScript(res=Slider(8, range=0..10), dim=Slider(7.819, range=0..10), s_pt=pt)  # -> console, a, b, c; inputs res: Int32
# ---------- decodes: Python ----------
vf = VecField(pixel_res=Interval(res,res), spatial_origin=Point(dim/2,dim/4), spatial_dim=Interval(dim,dim/2))

for x in range(vf.px_width):
    for y in range(vf.px_height):
        vf.set(x,y,Vec(x/(y+1),y/(x+1)))


a.put(vf.to_rays())

#print vf.address_near(s_pt)
sample_vec = vf.vec_near(s_pt)

print vf.address_near(s_pt)


    
def avg_vec(vec_field,sample_pt):
    x = min(1.0,max(0.0,vec_field._sp_ival_x.deval(sample_pt.x)))
    y = min(1.0,max(0.0,vec_field._sp_ival_y.deval(sample_pt.y)))
    
    x0= Interval(0,vec_field.px_width).eval(x)
    y0= Interval(0,vec_field.px_height).eval(y)
    
    x1 = int(round(x0))
    y1 = int(round(y0))
    if x1 == vec_field.px_width : x1 = vec_field.px_width-1
    if y1 == vec_field.px_height : y1 = vec_field.px_height-1
    
    if x - x1 <= 0 : x2 = int(x1-1)
    else : x2 = int(x1+1)
    if y - y1 <= 0 : y2 = int(y1-1)
    else : y2 = int(y1+1)
    near_vecs = []
    near_vecs.extend([vec_field.get(x1,y1), vec_field.get(x1,y2), vec_field.get(x2,y2), vec_field.get(x2,y1)])
    #near_vecs[0].length *= 1/(distance)
    
    avg_vec = Vec.average(near_vecs)
    
    c.put(Ray(vec_field._base_pts[x1+y1*vec_field.px_width], near_vecs[0]))
    c.put(Ray(vec_field._base_pts[x1+y2*vec_field.px_width], near_vecs[1]))
    c.put(Ray(vec_field._base_pts[x2+y2*vec_field.px_width], near_vecs[2]))
    c.put(Ray(vec_field._base_pts[x2+y1*vec_field.px_width], near_vecs[3]))
    
    return avg_vec
    

b.put(Ray(s_pt,avg_vec(vf, s_pt)))
# ---------- end decodes ----------
geo = Geometry(decodes.c)
geo_2 = Geometry(decodes.b)
panel = Panel(decodes.console)
