# Grasshopper definition quadtreeclass.gh (Grasshopper 0.9.14)
# plug-ins: Decodes Python Interpreter

slider = Slider(9, range=0..10)
pt = Point(Point(4.370143807, 4.199721879, 0))
decodes = DecodesPythonScript(y=pt, w2=slider, h2=slider)  # -> console, a, b, c
# ---------- decodes: Python ----------
class Rect():
    """
    A rectangle class with centerpoint, width and height
    """
    def __init__ (self, center, w, h):
        self.cpt = center
        self.width = w
        self.height = h
        
    @property
    def corners(self):
        cpts = []
        hw = self.width/2
        hh = self.height/2
        self.height/2
        cpts.append(Point(self.cpt.x-(hw),self.cpt.y-(hh)))
        cpts.append(Point(self.cpt.x-(hw),self.cpt.y+(hh)))
        cpts.append(Point(self.cpt.x+(hw),self.cpt.y+(hh)))
        cpts.append(Point(self.cpt.x+(hw),self.cpt.y-(hh)))
        return cpts
        
    def contains(self, pt):
        hw = self.width/2
        hh = self.height/2
        lbx = self.cpt.x - hw
        ubx = self.cpt.x + hw
        lby = self.cpt.y - hh
        uby = self.cpt.y + hh
        if lbx < pt.x < ubx and lby < pt.y < uby : return True
        else:return False
    
    def intersects(self, rect) :
        val= False
        for p in rect.corners :
            if val == True : break
            else:
                if self.contains(p) : val = True
                else : val = False
        for c in self.corners :
            if val == True : break
            else:
                if rect.contains(c) : val = True
                else : val = False
        return val

tp = y
rcent = Point(4,3,5)
rectagon = Rect (rcent, 3, 5) 
rcent2 = y
rectagon2 = Rect (rcent2, w2, h2)

Answer = rectagon.intersects(rectagon2)
print Answer
a.put(rectagon.corners)
b.put(rectagon2.corners)
c.put(Rect)
# ---------- end decodes ----------
geo = Geometry(decodes.a)
geo_2 = Geometry(decodes.b)
pline = PolyLine(Vertices=geo_2, Closed=True)
decodes_2 = DecodesPythonScript(x=decodes.c)  # -> console, a
# ---------- decodes_2: Python ----------
rectagon3 = Rect(Point(), 3, 3)
a.put(rectagon3)
# ---------- end decodes_2 ----------
pline_2 = PolyLine(Vertices=geo, Closed=True)
panel = Panel(decodes.console)
